# Grasshopper definition R-values V4.gh (Grasshopper 1.0.7)
# plug-ins: Pufferfish

# ---- group: Entert
pt = Point([<point referenced from the Rhino model> x850])

# ----
number_slider = Slider(1.26, range=0..10)
# R-Values and Resilience Potential
# Measuring Resilient Communities
# Lubo Jankovic and Silvio Carta
# last update: 7 March 2023
centre = Point(<point referenced from the Rhino model>)
educat = Point([<point referenced from the Rhino model> x1690])
trasnsp = Point([<point referenced from the Rhino model> x5000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])
entert = Point([<point referenced from the Rhino model> x3926])
pdecon = Deconstruct(Point=pt)  # -> XComponent, YComponent, ZComponent

# ---- group: Education
pt_2 = Point([<point referenced from the Rhino model> x530])

# ----
pdecon_2 = Deconstruct(Point=pt_2)  # -> XComponent, YComponent, ZComponent

# ---- group: transport hubs
pt_3 = Point([<point referenced from the Rhino model> x2626])

# ----
pdecon_3 = Deconstruct(Point=pt_3)  # -> XComponent, YComponent, ZComponent
ln = Line(StartPoint=centre, EndPoint=educat)
dist = Distance(PointA=centre, PointB=educat)  # disabled
dist_2 = Distance(PointA=centre, PointB=trasnsp)  # disabled
dist_3 = Distance(PointA=centre, PointB=entert)  # disabled
education_points = Point(pt_2)
pt_4 = ConstructPoint(XCoordinate=pdecon_2.XComponent, YCoordinate=pdecon_2.YComponent, ZCoordinate=pdecon_2.ZComponent)
pt_5 = ConstructPoint(XCoordinate=pdecon.XComponent, YCoordinate=pdecon.YComponent, ZCoordinate=pdecon.ZComponent)
pt_6 = ConstructPoint(XCoordinate=pdecon_3.XComponent, YCoordinate=pdecon_3.YComponent, ZCoordinate=pdecon_3.ZComponent)
circle = CircleCNR(Center=pt_2, Normal=Vector(0, 0, 1), Radius=expr("x/2", number_slider))
item = ListItem(List=pt_4, Index=Slider(0, range=0..10), Wrap=True)

# ---- group: Distances from Centre in Km
panel = Panel(dist_2)
panel_2 = Panel(dist)
panel_3 = Panel(dist_3)

# ----
panel_4 = Panel(pt_5)
panel_5 = Panel(pt_4)
graft = GraftTree(Tree=education_points, IncludeEmptyLists=True, IncludeNullItems=True)
path_mapper = PathMapper(graft, source="{A;B}", target="{B}")
panel_6 = Panel(pt_6)

# ---- group: tiles around each education point
bbox = BoundingBox(Content=circle, Plane=PlaneXY(0, 0, 0))  # -> Box, Box_2

# ----
graft_2 = GraftTree(Tree=bbox.Box, IncludeEmptyLists=True, IncludeNullItems=True)
cir = Circle(Plane=item, Radius=expr("x/2", number_slider))
debrep = DeconstructBrep(Brep=bbox.Box)  # -> Faces, Edges, Vertices
pdecon_4 = Deconstruct(Point=path_mapper)  # -> XComponent, YComponent, ZComponent
python = GhPythonScript(distance=panel_2)  # -> out, a; inputs distance: Int32
# ---------- python: Python ----------
__author__ = "sc13adx"
__version__ = "2021.04.15"

import rhinoscriptsyntax as rs
"""hospitals"""

x = distance 

if x <=1.6:
    a = 1
elif x >1.6 and x<=2.4:
    a = 0.75
elif x > 2.4 and x<=8:
    a = 0.5
else:
    a = 0.25
# ---------- end python ----------
python_2 = GhPythonScript(distance=panel)  # -> a; inputs distance: Int32
# ---------- python_2: Python ----------
__author__ = "sc13adx"
__version__ = "2021.04.15"

import rhinoscriptsyntax as rs
"""hospitals"""

x = distance 

if x <=12.5:
    a = 1
elif x >12.5 and x<=25:
    a = 0.50
else:
    a = 0.25
# ---------- end python_2 ----------
python_3 = GhPythonScript(distance=panel_3)  # -> out, a; inputs distance: Int32
# ---------- python_3: Python ----------
__author__ = "sc13adx"
__version__ = "2021.04.15"

import rhinoscriptsyntax as rs

x = distance 

if x <=1.6:
    a = 1
elif x >1.6 and x<=2.4:
    a = 0.75
elif x > 2.4 and x<=8:
    a = 0.5
else:
    a = 0.25
# ---------- end python_3 ----------
crv = Curve(debrep.Faces)

# ---- group: education points (branched)
pt_7 = ConstructPoint(XCoordinate=pdecon_4.XComponent, YCoordinate=pdecon_4.YComponent, ZCoordinate=0)

# ----
graft_3 = GraftTree(Tree=pt_4, IncludeEmptyLists=True, IncludeNullItems=True)
number_slider_2 = Slider(0, range=0..100)
viewer = ParamViewer(graft_3)
incurves = PointInCurves(Point=pt_3, Curves=crv)  # -> Relationship, Index, Point
bool = Boolean(incurves.Relationship)

# ---- group: Gamma Coefficient
panel_7 = Panel(python_2)
panel_8 = Panel(python.a)
panel_9 = Panel(python_3.a)

# ----
dispatch = Dispatch(List=incurves.Point, DispatchPattern=bool)  # -> ListA, ListB
panel_10 = Panel(graft_3)
points_in_tile = Point(dispatch.ListA)
points_outside_tile = Point(dispatch.ListB)
pt_8 = ConstructPoint(XCoordinate=number_slider_2, YCoordinate=number_slider_2, ZCoordinate=number_slider_2)
multiplication = Multiplication(A=panel_2, B=panel_8)
multiplication_2 = Multiplication(A=panel, B=panel_7)
multiplication_3 = Multiplication(A=panel_3, B=panel_9)
path_mapper_2 = PathMapper(points_in_tile, source="{A;B;C}", target="{C}")

# ---- group: transport hub points within each tile (branched)
panel_11 = Panel(path_mapper_2)

# ----
ln_2 = Line(StartPoint=panel_11, EndPoint=pt_7)  # disabled
dist_4 = Distance(PointA=pt_7, PointB=panel_11)

# ---- group: Resilience Values (to be summated)
panel_12 = Panel(multiplication)
panel_13 = Panel(multiplication_2)
panel_14 = Panel(multiplication_3)

# ---- group: Distances from Centre in Km
panel_15 = Panel(dist_4)

# ----
ma = MassAddition(Input=panel_12)  # -> Result, PartialResults
lng = ListLength(List=ma.PartialResults)
ma_2 = MassAddition(Input=panel_13)  # -> Result, PartialResults
lng_2 = ListLength(List=ma_2.PartialResults)
ma_3 = MassAddition(Input=panel_14)  # -> Result, PartialResults
lng_3 = ListLength(List=ma_3.PartialResults)
panel_16 = Panel(path_mapper_2)
viewer_2 = ParamViewer(path_mapper_2)
python_4 = GhPythonScript(distance=panel_15)  # -> out, a; inputs distance: Int32; same code as python
division = Division(A=ma.Result, B=lng)
division_2 = Division(A=ma_2.Result, B=lng_2)
division_3 = Division(A=ma_3.Result, B=lng_3)

# ---- group: Gamma Coefficient
panel_17 = Panel(python_4.a)

# ---- group: Resilience Value R (educ)
panel_18 = Panel(division)

# ---- group: Resilience Value R (transp)
panel_19 = Panel(division_2)

# ---- group: Resilience Value R (Entert)
panel_20 = Panel(division_3)

# ----
multiplication_4 = Multiplication(A=panel_15, B=panel_17)
merge = Merge(Data1=panel_18, Data2=panel_19, Data3=panel_20)

# ---- group: Resilience Values (to be summated)
panel_21 = Panel(multiplication_4)

# ----
ma_4 = MassAddition(Input=merge)  # -> Result, PartialResults
lng_4 = ListLength(List=merge)
division_4 = Division(A=ma_4.Result, B=lng_4)

# ---- group: Total Resilience Value R
# London 4.82
# Cairo 5.89
# Moscow 5.78
# Munich 14.14
# Toronto 4.69
# Seattle 7.56
# Delhi 4.92
# Singapore 4.53
# Melbourne 6.70
# Rio 6.70
# Pittsburgh 6.55
# Beijing 7.39
# Buenos Aires 4.06
# Stockholm 3.92
# Tokyo 6.97
panel_22 = Panel(division_4)

# ----
ma_5 = MassAddition(Input=panel_21)  # -> Result, PartialResults
lng_5 = ListLength(List=ma_5.PartialResults)
division_5 = Division(A=ma_5.Result, B=lng_5)

# ---- group: Resilience Value R (educ)
panel_23 = Panel(division_5)

# ----
lng_6 = ListLength(List=panel_23)
ma_6 = MassAddition(Input=panel_23)  # -> Result, PartialResults
division_6 = Division(A=ma_6.Result, B=lng_6)

# ---- group: Total Resilience Value R per tile
panel_24 = Panel(division_6)

# ---- group: small test
pt_9 = Point([<point referenced from the Rhino model> x22])
crv_2 = Curve([<curve referenced from the Rhino model> x3])
graft_4 = GraftTree(Tree=crv_2, IncludeEmptyLists=True, IncludeNullItems=True)
incurves_2 = PointInCurves(Point=pt_9, Curves=graft_4)  # -> Relationship, Index, Point
bool_2 = Boolean(incurves_2.Relationship)
dispatch_2 = Dispatch(List=incurves_2.Point, DispatchPattern=bool_2)  # -> ListA, ListB
points_in_tile_2 = Point(dispatch_2.ListA)
points_outside_tile_2 = Point(dispatch_2.ListB)
bang = ExplodeTree(Data=points_in_tile_2)  # -> Branch0, Branch1, Branch2
pt_10 = Point(bang.Branch2)

# ---- group: Distance in Km
pdecon_5 = Deconstruct(Point=path_mapper_2)  # -> XComponent, YComponent, ZComponent; disabled
pdecon_6 = Deconstruct(Point=graft_3)  # -> XComponent, YComponent, ZComponent; disabled
pdecon_7 = Deconstruct(Point=path_mapper_2)  # -> XComponent, YComponent, ZComponent; disabled
pdecon_8 = Deconstruct(Point=graft_3)  # -> XComponent, YComponent, ZComponent; disabled
subtraction = Subtraction(A=pdecon_5.XComponent, B=pdecon_6.XComponent)  # disabled
subtraction_2 = Subtraction(A=pdecon_7.YComponent, B=pdecon_8.YComponent)  # disabled
sqr = Square(Value=subtraction)  # disabled
sqr_2 = Square(Value=subtraction_2)  # disabled
addition = Addition(A=sqr, B=sqr_2)  # disabled
sqrt = SquareRoot(Value=addition)  # disabled

# ----
panel_25 = Panel(sqrt)  # disabled
number_slider_3 = Slider(0, range=0..100)  # disabled
cull_i = CullIndex(List=sqrt, Indices=number_slider_3, Wrap=True)  # disabled

# ---- group: Probability to connect p(i)
hilonums = HighestLowestNumbers(Numbers=sqrt)  # -> Highest, Lowest; disabled
panel_26 = Panel("1")  # disabled
division_7 = Division(A=sqrt, B=hilonums.Highest)  # disabled
subtraction_3 = Subtraction(A=panel_26, B=division_7)  # disabled

# ----
panel_27 = Panel(cull_i)  # disabled
bool_3 = Boolean(subtraction_3)  # disabled
dispatch_3 = Dispatch(List=subtraction_3, DispatchPattern=bool_3)  # -> ListA, ListB; disabled

# ---- group: Normalised probability
ma_7 = MassAddition(Input=dispatch_3.ListA)  # -> Result, PartialResults; disabled
division_8 = Division(A=subtraction_3, B=ma_7.Result)  # disabled

# ---- group: p(i)*log(p(i))
panel_28 = Panel("2")  # disabled
logn = LogN(Number=division_8, Base=panel_28)  # disabled
multiplication_5 = Multiplication(A=division_8, B=logn)  # disabled

# ----
panel_29 = Panel("-1")  # disabled
clean = CleanTree(RemoveNulls=True, RemoveInvalid=True, RemoveEmpty=False, Tree=multiplication_5)  # disabled
ma_8 = MassAddition(Input=clean)  # -> Result, PartialResults; disabled
multiplication_6 = Multiplication(A=ma_8.Result, B=panel_29)  # disabled
panel_30 = Panel(multiplication_6)  # disabled
lng_7 = ListLength(List=clean)  # disabled

# ---- group: Maximum entropy Hmax
tstat = TreeStatistics(Tree=multiplication_5)  # -> Paths, Length, Count; disabled
panel_31 = Panel("2")  # disabled
logn_2 = LogN(Number=lng_7, Base=panel_31)  # disabled

# ----
panel_32 = Panel(lng_7)  # disabled

# ---- group: Shannon entropy H
division_9 = Division(A=multiplication_6, B=logn_2)  # disabled
clean_2 = CleanTree(RemoveNulls=True, RemoveInvalid=True, RemoveEmpty=False, Tree=division_9)  # disabled

# ----
viewer_3 = ParamViewer(clean_2)  # disabled
panel_33 = Panel(clean_2)  # disabled
